# Grasshopper definition final.gh (Grasshopper 1.0.7)
# plug-ins: MarchingCubes

file_path = FilePath("C:\Users\jacob\Downloads\4ec7.pdb")
import_pdb = ImportPDB(File=file_path)  # -> Atoms, Bonds
atom_data = AtomData(Atom=import_pdb.Atoms)  # -> Point, Element, Chain, Residue, Charge, Occupancy, Temperature, AtomicNumber, SerialNumber, ResidueNumber
trim_tolerance = Slider(8.6, range=0..10)
point = Point(atom_data.Point)
cull_duplicates = CullDuplicates(Points=point, Tolerance=trim_tolerance, CullMode=3)  # -> Points, Indices, Valence
list_length = ListLength(List=cull_duplicates.Points)
charge_strength = Slider(0.4, range=0..1)
repeat_data = RepeatData(Data=charge_strength, Length=list_length)

# ---- group: RH_IN:Size
point_charge_radius = Slider(11, range=0..50)

# ----
point_charge = PointCharge(Point=cull_duplicates.Points, Radius=point_charge_radius, ChargeStrength=repeat_data)
target_iso_value = Slider(0.3, range=0..1)
cell_size = Slider(3, range=0..10)
cocoon = Cocoon(Charges=point_charge, Iso=target_iso_value, CellSize=cell_size, Execute=Toggle(True), Simple=False)  # -> Mesh, RefinementData
number_slider = Slider(15, range=0..100)
refine = Refine(
    RefinementData=cocoon.RefinementData,
    Samples=number_slider,
    SampleSize=Slider(5.5, range=0..10),
    SampleTolerance=Slider(0.01, range=0..0.01),
    LaplacianSmoothing=number_slider,
    ValencePasses=number_slider,
    SubD=Slider(3, range=0..10),
    Execute=Toggle(True))
c_script = CSharpScript(mesh=refine)  # -> base64Draco; inputs mesh: Mesh
# ---------- c_script: C# ----------
    var options = new Rhino.FileIO.DracoCompressionOptions();
    options.CompressionLevel = 5;
    options.IncludeTextureCoordinates = false;
    options.IncludeVertexColors = false;

    var compressed = Rhino.FileIO.DracoCompression.Compress(mesh, options);
    base64Draco = compressed.ToBase64String();
# ---------- end c_script ----------

# ---- group: RH_OUT:Mesh
txt = Text(c_script)
