# Grasshopper definition stringPDB.gh (Grasshopper 1.0.7)
# plug-ins: MarchingCubes

panel = Panel("""ATOM      1  N   LEU A   1      40.310  22.627 119.798  1.00  0.00           N
ATOM      2  H   LEU A   1      40.926  21.857 119.772  1.00  0.00           H
ATOM      3  CA  LEU A   1      40.864  23.993 119.886  1.00  0.00""")
pdbid = GetString(panel, AtLeast=1, AtMost=1, TreeAccess=False)
python = GhPythonScript(pdb_content=pdbid)  # -> atom_record
# ---------- python: Python ----------
import re
import rhinoscriptsyntax as rs 

positions = []
for line in pdb_content.split('\n'):
    if line.startswith('ATOM'):
        parts = line.split()
        x = float(parts[6])
        y = float(parts[7])
        z = float(parts[8])
        positions.append(rs.CreatePoint(x, y, z))
        
atom_record = positions
# ---------- end python ----------
trim_tolerance = Slider(8.6, range=0..10)
trim_tolerance_2 = GetNumber(trim_tolerance, AtLeast=1, AtMost=1, Maximum=1.797693135e+308, Minimum=-1.797693135e+308, TreeAccess=False)
cull_duplicates = CullDuplicates(Points=python, Tolerance=trim_tolerance_2, CullMode=3)  # -> Points, Indices, Valence
list_length = ListLength(List=cull_duplicates.Points)
charge_strength = Slider(0.4, range=0..1)
charge_strength_2 = GetNumber(charge_strength, AtLeast=1, AtMost=1, Maximum=1.797693135e+308, Minimum=-1.797693135e+308, TreeAccess=False)
repeat_data = RepeatData(Data=charge_strength_2, Length=list_length)
point_charge_radius = Slider(17.7, range=0..50)
radius = GetNumber(point_charge_radius, AtLeast=1, AtMost=1, Maximum=1.797693135e+308, Minimum=-1.797693135e+308, TreeAccess=False)
point_charge = PointCharge(Point=cull_duplicates.Points, Radius=radius, ChargeStrength=repeat_data)
target_iso_value = Slider(0.1, range=0..1)
cell_size = Slider(2.5, range=0..10)
cocoon = Cocoon(Charges=point_charge, Iso=target_iso_value, CellSize=cell_size, Execute=Toggle(True), Simple=False)  # -> Mesh, RefinementData
number_slider = Slider(10, range=0..100)
refine = Refine(
    RefinementData=cocoon.RefinementData,
    Samples=number_slider,
    SampleSize=Slider(5.5, range=0..10),
    SampleTolerance=Slider(0.01, range=0..0.01),
    LaplacianSmoothing=number_slider,
    ValencePasses=number_slider,
    SubD=Slider(1, range=0..10),
    Execute=Toggle(True))
c_script = CSharpScript(mesh=refine)  # -> graft(base64Draco); inputs mesh: Mesh
# ---------- c_script: C# ----------
    var options = new Rhino.FileIO.DracoCompressionOptions();
    options.CompressionLevel = 5;
    options.IncludeTextureCoordinates = false;
    options.IncludeVertexColors = false;

    var compressed = Rhino.FileIO.DracoCompression.Compress(mesh, options);
    base64Draco = compressed.ToBase64String();
# ---------- end c_script ----------

# ---- group: RH_OUT:Mesh
txt = Text(c_script)
